# Dynamo graph truss node.dyn (Dynamo 2.1.0.7500)

# group: 斜腹杆主体
code_block = CodeBlock()
# ---------- code_block.designscript (23 lines) ----------
k = 0;
v1 = Vector.ByCoordinates(-k/2, -k/2, -k/Math.Sqrt(2));
v2 = Vector.ByCoordinates(k/2, k/2, k/Math.Sqrt(2));

l = 600;
d = 30;

p1 = Point.ByCoordinates(l/2, l/2, l/Math.Sqrt(2));
vv1 = Vector.ByCoordinates(-d/2, -d/2, d/Math.Sqrt(2));
vv2 = Vector.ByCoordinates(d/2, d/2, -d/Math.Sqrt(2));
vv3 = Vector.ByCoordinates(-d/Math.Sqrt(2), d/Math.Sqrt(2));
vv4 = Vector.ByCoordinates(d/Math.Sqrt(2), -d/Math.Sqrt(2));
p11 = Geometry.Translate(Geometry.Translate(p1, vv1), vv4);
p12 = Geometry.Translate(Geometry.Translate(p1, vv1), vv3);
p13 = Geometry.Translate(Geometry.Translate(p1, vv2), vv3);
p14 = Geometry.Translate(Geometry.Translate(p1, vv2), vv4);

p1a = Geometry.Translate(p11, v1);
p2a = Geometry.Translate(p12, v1);
p3a = Geometry.Translate(p13, v2);
p4a = Geometry.Translate(p14, v2);

Polygon.ByPoints([p1a, p2a, p3a, p4a]);
# ----------------------------------------
code_block_2 = CodeBlock { k = 507; d = Vector.ByCoordinates(-k/2, -k/2, -k/Math.Sqrt(2)); }
extrudeAsSolid = Curve.ExtrudeAsSolid(curve=code_block.out18, direction=code_block_2.d)
code_block_3 = CodeBlock { Point.Origin(); Vector.ZAxis(); [0, 90, 180, 270]; }
rotate = Geometry.Rotate(geometry=extrudeAsSolid, origin=code_block_3.out0, axis=code_block_3.out1, degrees=code_block_3.out2)
code_block_4 = CodeBlock { 255; 241; 162; 20; }
byARGB = Color.ByARGB(a=code_block_4.out0, r=code_block_4.out1, g=code_block_4.out2, b=code_block_4.out3)
byGeometryColor = Modifiers.GeometryColor.ByGeometryColor(geometry=rotate, color=byARGB)

# group: 斜腹杆端口
code_block_5 = CodeBlock()
# ---------- code_block_5.designscript (10 lines) ----------
d = 60/2;
x = 20;
p1 = Point.ByCoordinates(0, 0, -d);
p2 = Point.ByCoordinates(0, 0, d);
p3 = Point.ByCoordinates(-x, 0, d);
p4 = Point.ByCoordinates(-x, 0, -0.3);
p5 = Point.ByCoordinates(-x, 0, -d);

poly = Polygon.ByPoints([p1, p2, p3, p4, p5]);
Surface.Thicken(Surface.ByPatch(poly), d*2, true);
# ----------------------------------------
code_block_6 = CodeBlock { Point.Origin(); Vector.YAxis(); -45; }
rotate_2 = Geometry.Rotate(geometry=code_block_5.out8, origin=code_block_6.out0, axis=code_block_6.out1, degrees=code_block_6.out2)
code_block_7 = CodeBlock { Point.Origin(); Vector.ZAxis(); 45; }
rotate_3 = Geometry.Rotate(geometry=rotate_2, origin=code_block_7.out0, axis=code_block_7.out1, degrees=code_block_7.out2)
code_block_8 = CodeBlock { d = 93; d/2; d/2; d/Math.Sqrt(2); }
translate = Geometry.Translate(geometry=rotate_3, xTranslation=code_block_8.out1, yTranslation=code_block_8.out2, zTranslation=code_block_8.out3)
code_block_9 = CodeBlock { Point.Origin(); Vector.ZAxis(); [0, 90, 180, 270]; }
rotate_4 = Geometry.Rotate(geometry=translate, origin=code_block_9.out0, axis=code_block_9.out1, degrees=code_block_9.out2)
code_block_10 = CodeBlock { 255; 241; 162; 20; }
byARGB_2 = Color.ByARGB(a=code_block_10.out0, r=code_block_10.out1, g=code_block_10.out2, b=code_block_10.out3)
byGeometryColor_2 = Modifiers.GeometryColor.ByGeometryColor(geometry=rotate_4, color=byARGB_2)

# group: 底板+斜腹杆钢板
code_block_11 = CodeBlock()
# ---------- code_block_11.designscript (18 lines) ----------
d1 = 28;
d2 = 155;
p1 = Point.ByCoordinates(-d1, d1, 0);
p2 = Point.ByCoordinates(d1, d1, 0);
p3 = Point.ByCoordinates(d1, -d1, 0);
p4 = Point.ByCoordinates(-d1, -d1, 0);

p5 = Point.ByCoordinates(-d1, d2, 0);
p6 = Point.ByCoordinates(d1, d2, 0);
p7 = Point.ByCoordinates(d2, d1, 0);
p8 = Point.ByCoordinates(d2, -d1, 0);
p9 = Point.ByCoordinates(d1, -d2, 0);
p10 = Point.ByCoordinates(-d1, -d2, 0);
p11 = Point.ByCoordinates(-d2, -d1, 0);
p12 = Point.ByCoordinates(-d2, d1, 0);

poly = Polygon.ByPoints([p1, p5, p6, p2, p7, p8, p3, p9, p10, p4, p11, p12]);
surf = Surface.ByPatch(poly);
# ----------------------------------------
code_block_12 = CodeBlock { 6; false; }
thicken = Surface.Thicken(surface=code_block_11.surf, thickness=code_block_12.out0, both_sides=code_block_12.out1)
code_block_13 = CodeBlock()
# ---------- code_block_13.designscript (18 lines) ----------
d1 = 39.6;
d2 = 190;
d3 = 56;

v1 = Vector.ByCoordinates(d2/Math.Sqrt(2), 0, d2/Math.Sqrt(2));
v2 = Vector.ByCoordinates(-d3/Math.Sqrt(2), 0, d3/Math.Sqrt(2));
v3 = Vector.ByCoordinates(-d2/Math.Sqrt(2), 0, d2/Math.Sqrt(2));
v4 = Vector.ByCoordinates(d3/Math.Sqrt(2), 0, d3/Math.Sqrt(2));
p1 = Point.ByCoordinates(d1, 0, 0);
p2 = Geometry.Translate(p1, v1);
p3 = Geometry.Translate(p2, v2);
p4 = Point.ByCoordinates(0, 0, d1);
p5 = Point.ByCoordinates(-d1, 0, 0);
p6 = Geometry.Translate(p5, v3);
p7 = Geometry.Translate(p6, v4);

poly = Polygon.ByPoints([p1, p2, p3, p4, p7, p6, p5]);
surf = Surface.ByPatch(poly);
# ----------------------------------------
code_block_14 = CodeBlock { 6; true; }
thicken_2 = Surface.Thicken(surface=code_block_13.surf, thickness=code_block_14.out0, both_sides=code_block_14.out1)
code_block_15 = CodeBlock { Point.Origin(); Vector.ZAxis(); [45, -45]; }
rotate_5 = Geometry.Rotate(geometry=thicken_2, origin=code_block_15.out0, axis=code_block_15.out1, degrees=code_block_15.out2)
byUnion = Solid.ByUnion(solids=rotate_5)
list_create = List.Create(item0=thicken, item1=byUnion)
byUnion_2 = Solid.ByUnion(solids=list_create)
code_block_16 = CodeBlock { 255; 119; 136; 153; }
byARGB_3 = Color.ByARGB(a=code_block_16.out0, r=code_block_16.out1, g=code_block_16.out2, b=code_block_16.out3)
byGeometryColor_3 = Modifiers.GeometryColor.ByGeometryColor(geometry=byUnion_2, color=byARGB_3)

byGeometry = ImportInstance.ByGeometry(geometry=byUnion_2)
byGeometry_2 = ImportInstance.ByGeometry(geometry=rotate)
byGeometry_3 = ImportInstance.ByGeometry(geometry=rotate_4)

# group: 螺栓
螺栓 = CodeBlock()
# ---------- 螺栓.designscript (8 lines) ----------
c1 = Circle.ByCenterPointRadiusNormal(Point.Origin(), 6, Vector.XAxis());
s1 = Surface.Thicken(Surface.ByPatch(c1), 56, true);
c2 = Circle.ByCenterPointRadiusNormal(Point.ByCoordinates(-28, 0, 0), 8, Vector.XAxis());
s2 = Surface.Thicken(Surface.ByPatch(c2), -4, false);
c3 = Circle.ByCenterPointRadiusNormal(Point.ByCoordinates(28, 0, 0), 8, Vector.XAxis());
s3 = Surface.Thicken(Surface.ByPatch(c3), 4, false);
s = Solid.ByUnion([s1, s2, s3]);
rotate = Solid.Rotate(s, Point.Origin(), Vector.ZAxis(), -45);
# ----------------------------------------
code_block_17 = CodeBlock(rotate=螺栓.rotate)
# ---------- code_block_17.designscript (4 lines) ----------
l = [193, 143, 93];
p1 = Point.ByCoordinates(l/2, l/2, l/Math.Sqrt(2));

s = Geometry.Translate(rotate, Point.X(p1), Point.Y(p1), Point.Z(p1));
# ----------------------------------------
code_block_18 = CodeBlock { Point.Origin(); Vector.ZAxis(); [[0, 90, 180, 270], [0, 90, 180, 270], [0, 90, 180, 270]]; }
rotate_6 = Geometry.Rotate(geometry=code_block_17.s, origin=code_block_18.out0, axis=code_block_18.out1, degrees=code_block_18.out2)

byGeometry_4 = ImportInstance.ByGeometry(geometry=rotate_6)
